# Grasshopper definition 01_quarry_to_wall.gh (Grasshopper 1.0.8)
# plug-ins: Frahan StonePack

A = A({Plane=PlaneXY(0, 0, 0), X=Domain(0, 10), Y=Domain(0, 8), Z=Domain(0, 2)})
F = F(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)
lx = Lx(3)
ly = Ly(2)
lz = Lz(0.8)
bcosolve = BlockCutOptSolve(
    TestedArea=A,
    Fractures=F,
    BlockX=lx,
    BlockY=ly,
    BlockZ=lz,
    Kerf=0.05,
    PsiStepDeg=3,
    DxMax=1.5,
    DxStep=0.5,
    DyMax=1.5,
    DyStep=0.5)  # -> NonIntersectedCount, Recovery, BestPsiDeg, BestDxM, BestDyM, Evaluations, ElapsedMs
_01_quarry_to_wall_recovery = Panel(bcosolve.Recovery)
_01_quarry_to_wall_block_count = Panel(bcosolve.NonIntersectedCount)
